# Grasshopper definition Reverse Engineer Canopy2 .gh (Grasshopper 1.0.7)
# plug-ins: Bifocals

# ---- group: Parameters
first_curve_size = Slider(1.8, range=0.5..5)
total_curves = Slider(21, range=2..50)
height_between_curves = Slider(3.635, range=2..10)
width_between_curves = Slider(1.253, range=0.5..10)
angle_rotation = Slider(295, range=1..360)
scale = Slider(3.2, range=0.5..20)

# ---- group: Main Curve Creation
pi = Pi(Factor="2")
range = Range(Domain=pi, Steps=12)
split_list = SplitList(List=range, Index="7")  # -> ListA, ListB
golden_ratio = GoldenRatio(Factor=split_list.ListA)
point_polar = PointPolar(BasePlane=PlaneXY(0, 0, 0), XYAngle=split_list.ListA, ZAngle=0, Offset=golden_ratio)
interpolate_t = InterpolateT(Vertices=point_polar, TangentStart=Vector(0, 0, 0), TangentEnd=Vector(0, 0, 0), KnotStyle=1)  # -> Curve, Length, Domain
connect_curves = ConnectCurves(Curves=interpolate_t.Curve, Continuity=0, Close=True, Bulge=1)

# ---- group: Bring Curve to World Center
construct_point = ConstructPoint(XCoordinate=0, YCoordinate=0, ZCoordinate=0)
area = Area(Geometry=connect_curves)  # -> Area, Centroid
vector_2pt = Vector2Pt(PointA=area.Centroid, PointB=construct_point, Unitize=False)  # -> Vector, Length
move = Move(Geometry=connect_curves, Motion=vector_2pt.Vector)  # -> Geometry, Transform

# ----
division = Division(A=scale, B=10)
division_2 = Division(A=angle_rotation, B=total_curves)
series = Series(Start=0, Step=height_between_curves, Count=total_curves)
scale_2 = Scale(Geometry=move.Geometry, Center=construct_point, Factor=first_curve_size)  # -> Geometry, Transform
series_2 = Series(Start=0, Step=division_2, Count=total_curves)
series_3 = Series(Start=1, Step=division, Count=total_curves)
unit_z = UnitZ(Factor=series)
move_2 = Move(Geometry=scale_2.Geometry, Motion=unit_z)  # -> Geometry, Transform
rotate = Rotate(Geometry=move_2.Geometry, Angle=degrees(series_2), Plane=PlaneXY(0, 0, 0))  # -> Geometry, Transform
curve = Curve(move_2.Geometry)
area_2 = Area(Geometry=rotate.Geometry)  # -> Area, Centroid
area_3 = Area(Geometry=curve)  # -> Area, Centroid
scale_3 = Scale(Geometry=rotate.Geometry, Center=area_2.Centroid, Factor=series_3)  # -> Geometry, Transform
scale_4 = Scale(Geometry=curve, Center=area_3.Centroid, Factor=width_between_curves)  # -> Geometry, Transform
rotate_2 = Rotate(Geometry=scale_4.Geometry, Angle=degrees(series_2), Plane=PlaneXY(0, 0, 0))  # -> Geometry, Transform
scale_5 = Scale(Geometry=rotate_2.Geometry, Center=area_2.Centroid, Factor=series_3)  # -> Geometry, Transform
boundary_surfaces = BoundarySurfaces(Edges=scale_5.Geometry)
split_brep = SplitBrep(Brep=boundary_surfaces, Cutter=scale_3.Geometry)
unit_z_2 = UnitZ(Factor=height_between_curves)
list_item = ListItem(List=split_brep, Index=1, Wrap=True)
extrude = Extrude(Base=list_item, Direction=unit_z_2)
